# Grasshopper definition 1701117.gh (Grasshopper 0.9.76)
# plug-ins: Python Interpreter

boolean_toggle = BooleanToggle(True)
point = Point([<point referenced from the Rhino model> x10])
point_2 = Point([<point referenced from the Rhino model> x2])
point_3 = Point([<point referenced from the Rhino model> x10])
point_4 = Point([<point referenced from the Rhino model> x2])
point_5 = Point([<point referenced from the Rhino model> x3])
python_script = PythonScript(attrGUIDs=point_2, agentGUIDs=point, active=Toggle(False), count=Slider(65, range=0..100))  # -> out, a, b, crv; inputs attrGUIDs: list, agentGUIDs: list, active: Boolean, count: Int32
# ---------- python_script: Python ----------
import rhinoscriptsyntax as rs
import scriptcontext as sc
import System.Drawing as sd
import scriptcontext as sc
import Rhino.DocObjects as rd


class Attractor():
    def __init__(self,pos,ptID,mag):
        self.pos = pos
        self.ptID = ptID
        self.mag = mag
        self.vec = rs.VectorCreate([1,0,0],[0,0,0])
        
        
#    def walk(self):
#        self.pos = rs.PointAdd(self.pos, self.vec)
#        rs.DeleteObject(self.ptID)
#        
#        attribute = rd.ObjectAttributes()
#        attribute.ColorSource = rd.ObjectColorSource.ColorFromObject
#        attribute.ObjectColor = sd.Color.FromArgb(255,0,0)
#        self.ptID = sc.doc.Objects.AddPoint(self.pos, attribute)
        
        
    def force(self,agent):
        newVec = rs.VectorCreate(self.pos, agent.pos) 
        newVec = rs.VectorUnitize(newVec)
        dist = rs.Distance(self.pos, agent.pos)
        newVec = rs.VectorScale(newVec, self.mag/dist)
        return newVec
        
        
class Agent():
    def __init__(self,pos,ptID):
        self.pos = pos
        self.ptID = ptID
        self.vec = rs.VectorCreate([1,0,0],[0,0,0])
        self.trPts = []
        self.trPts.append(self.pos)
        self.trID = "not_curve"
        
        
    def move(self):
        self.pos = rs.PointAdd(self.pos, self.vec)
        self.trPts.append(self.pos)
        if len(self.trPts) > 1000:
            self.trPts.pop(0)
#        rs.DeleteObjects(self.ptID)
#        self.ptID = rs.AddPoint(self.pos)
        return rs.AddPoint(self.pos)
        
        
    def trajectory(self):
        if self.trID != "not_curve":
            rs.DeleteObject(self.trID) 
        self.trID =rs.AddCurve(self.trPts)
        
    def updateForce(self,attrPopulation):
        for attrPt in attrPopulation:
            forceVec = attrPt.force(self)
            self.vec = rs.VectorAdd(self.vec, forceVec)
            
            
    def update(self, attrPopulation):
        self.move()
        self.trajectory()
        self.updateForce(attrPopulation)
            

a = []
b = []
crv = []

if active:
    
    attrPopulation = []
    for attrGUID in attrGUIDs:
        attrCoord = rs.PointCoordinates(attrGUID)
        attrPopulation.append(Attractor(attrCoord, attrGUID, 1))
        
    agentPopulation = []
    for agentGUID in agentGUIDs:
        agentCoord = rs.PointCoordinates(agentGUID)
        agentPopulation.append(Agent(agentCoord, agentGUID))
        
        
        
    for i in range(count):
        rs.EnableRedraw(False)
        for agent in agentPopulation:
            agent.move()
            b.append(agent)

        rs.EnableRedraw(True)
# ---------- end python_script ----------
python_script_2 = PythonScript(attrGUIDs=point_4, agentGUIDs=point_3, count=Slider(0, range=0..100))  # -> out, a; inputs attrGUIDs: list, agentGUIDs: list, count: Int32
# ---------- python_script_2: Python ----------
import rhinoscriptsyntax as rs
import scriptcontext as sc
import System.Drawing as sd
import scriptcontext as sc
import Rhino.DocObjects as rd


class Attractor():
    def __init__(self,pos,ptID,mag):
        self.pos = pos
        self.ptID = ptID
        self.mag = mag
        self.vec = rs.VectorCreate([1,0,0],[0,0,0])
        
        
    def force(self,agent):
        newVec = rs.VectorCreate(self.pos, agent.pos) 
        newVec = rs.VectorUnitize(newVec)
        dist = rs.Distance(self.pos, agent.pos)
        newVec = rs.VectorScale(newVec, self.mag/dist)
        return newVec
        
        
class Agent():
    def __init__(self,pos,ptID):
        self.pos = pos
        self.ptID = ptID
        self.vec = rs.VectorCreate([1,0,0],[0,0,0])
        self.trPts = []
        self.trPts.append(self.pos)
        self.trID = "not_curve"
        
        
    def move(self):
        self.pos = rs.PointAdd(self.pos, self.vec)
        self.trPts.append(self.pos)
        return rs.AddPoint(self.pos)
        
        
    def updateForce(self,attrPopulation):
        for attrPt in attrPopulation:
            forceVec = attrPt.force(self)
            self.vec = rs.VectorAdd(self.vec, forceVec)
            print self.vec
            
            
    def update(self, attrPopulation):
        self.updateForce(attrPopulation)
        self.move()

a = []

attrPopulation = []
for attrGUID in attrGUIDs:
    attrCoord = rs.PointCoordinates(attrGUID)
    attrPopulation.append(Attractor(attrCoord, attrGUID, 1))
    
agentPopulation = []
for agentGUID in agentGUIDs:
    agentCoord = rs.PointCoordinates(agentGUID)
    agentPopulation.append(Agent(agentCoord, agentGUID))
    
    
for i in range(count):
    for agent in agentPopulation:
        agent.updateForce(attrPopulation)
        s = agent.move()
        a.append(s)
# ---------- end python_script_2 ----------
python_script_3 = PythonScript(pt=point_5, active=Toggle(True), count=Slider(11, range=0..100))  # -> out, a; inputs active: Boolean, count: Int32
# ---------- python_script_3: Python ----------
import rhinoscriptsyntax as rs
import scriptcontext as sc

a = []

def __init__(self, pt):
    self.pt = pt
    self.pos = rs.PointCoordinates(self.pt)
    
def update():
    pts = []
    vec = rs.VectorCreate([0,0,0], [1,0,0])
    self.pt = rs.PointAdd(self.pos, vec)
    pts.append(self.pos)

    return rs.AddPoint(self.pt)

    
    
if active:
    for i in range(count):
        a.append(update())
# ---------- end python_script_3 ----------
panel = Panel(python_script_3.a)
circle = Circle(python_script_2.out)
panel_2 = Panel(python_script.b)
panel_3 = Panel(python_script.a)
circle_2 = Circle(python_script_2.out)
circle_3 = Circle(python_script_2.out)
panel_4 = Panel(python_script_2.a)
circle_4 = Circle(circle_2)
circle_5 = Circle(circle_3)
circle_6 = Circle(circle)
