# Grasshopper definition 1701118.gh (Grasshopper 0.9.76)
# plug-ins: Python Interpreter

point = Point([<point referenced from the Rhino model> x2])
point_2 = Point([<point referenced from the Rhino model> x10])
point_3 = Point([<point referenced from the Rhino model> x10])
point_4 = Point([<point referenced from the Rhino model> x2])
swarm_curve_02 = PythonScript(attrGUIDs=point, agentGUIDs=point_2, count=Slider(0, range=0..200))  # -> out, a, b; inputs attrGUIDs: list, agentGUIDs: list, count: Int32
# ---------- swarm_curve_02: Python ----------
import rhinoscriptsyntax as rs
import scriptcontext as sc
import System.Drawing as sd
import scriptcontext as sc
import Rhino.DocObjects as rd


class Attractor():
    def __init__(self,pos,ptID,mag):
        self.pos = pos
        self.ptID = ptID
        self.mag = mag
        self.vec = rs.VectorCreate([1,0,0],[0,0,0])
        
        
    def force(self,agent):
        newVec = rs.VectorCreate(self.pos, agent.pos) 
        newVec = rs.VectorUnitize(newVec)
        dist = rs.Distance(self.pos, agent.pos)
        newVec = rs.VectorScale(newVec, self.mag/dist)
        return newVec
        
        
class Agent():
    def __init__(self,pos,ptID):
        self.pos = pos
        self.ptID = ptID
        self.vec = rs.VectorCreate([1,0,0],[0,0,0])
        self.trPts = []
        self.trPts.append(self.pos)
        self.trID = "not_curve"
        
        
    def move(self):
        self.pos = rs.PointAdd(self.pos, self.vec)
        self.trPts.append(self.pos)
        return rs.AddPoint(self.pos)
        
    def trajectory(self):
        return rs.AddCurve(self.trPts)
        
        
    def updateForce(self,attrPopulation):
        for attrPt in attrPopulation:
            forceVec = attrPt.force(self)
            self.vec = rs.VectorAdd(self.vec, forceVec)

a = []
b = []
attrPopulation = []
for attrGUID in attrGUIDs:
    attrCoord = rs.PointCoordinates(attrGUID)
    attrPopulation.append(Attractor(attrCoord, attrGUID, 1))
    
agentPopulation = []
for agentGUID in agentGUIDs:
    agentCoord = rs.PointCoordinates(agentGUID)
    agentPopulation.append(Agent(agentCoord, agentGUID))
    
    
for i in range(count):
    for agent in agentPopulation:
        agent.updateForce(attrPopulation)
        pts = agent.move()
#        crv = agent.trajectory()
        a.append(pts)
#        b.append(crv)
# ---------- end swarm_curve_02 ----------
swarm_curve = PythonScript(attrGUIDs=point_4, agentGUIDs=point_3, count=Slider(0, range=0..200))  # -> out, a, b; inputs attrGUIDs: list, agentGUIDs: list, count: Int32
# ---------- swarm_curve: Python ----------
import rhinoscriptsyntax as rs
import scriptcontext as sc
import System.Drawing as sd
import scriptcontext as sc
import Rhino.DocObjects as rd


class Attractor():
    def __init__(self,pos,ptID,mag):
        self.pos = pos
        self.ptID = ptID
        self.mag = mag
        self.vec = rs.VectorCreate([1,0,0],[0,0,0])
        
        
    def force(self,agent):
        newVec = rs.VectorCreate(self.pos, agent.pos) 
        newVec = rs.VectorUnitize(newVec)
        dist = rs.Distance(self.pos, agent.pos)
        newVec = rs.VectorScale(newVec, self.mag/dist)
        return newVec
        
        
class Agent():
    def __init__(self,pos,ptID):
        self.pos = pos
        self.ptID = ptID
        self.vec = rs.VectorCreate([1,0,0],[0,0,0])
        self.trPts = []
        self.trPts.append(self.pos)
        self.trID = "not_curve"
        
        
    def move(self):
        self.pos = rs.PointAdd(self.pos, self.vec)
        self.trPts.append(self.pos)
        return rs.AddPoint(self.pos)
        
    def trajectory(self):
        return rs.AddCurve(self.trPts)
        
        
    def updateForce(self,attrPopulation):
        for attrPt in attrPopulation:
            forceVec = attrPt.force(self)
            self.vec = rs.VectorAdd(self.vec, forceVec)

a = []
b = []
attrPopulation = []
for attrGUID in attrGUIDs:
    attrCoord = rs.PointCoordinates(attrGUID)
    attrPopulation.append(Attractor(attrCoord, attrGUID, 1))
    
agentPopulation = []
for agentGUID in agentGUIDs:
    agentCoord = rs.PointCoordinates(agentGUID)
    agentPopulation.append(Agent(agentCoord, agentGUID))
    
    
for i in range(count):
    for agent in agentPopulation:
        agent.updateForce(attrPopulation)
        pts = agent.move()
        crv = agent.trajectory()
        a.append(pts)
        b.append(crv)
# ---------- end swarm_curve ----------
interpolate = Interpolate(Vertices=swarm_curve_02.a, Degree=3, Periodic=False, KnotStyle=1)  # -> Curve, Length, Domain
